# Grasshopper definition VAE_Ishigami.gh (Grasshopper 1.0.7)
# plug-ins: DeCodingSpaces, Karamba3D, Kangaroo2 Components, LunchBox

# ---- group: RH_IN: w
number_slider = Slider(9, range=0..100)

# ---- group: RH_IN: p1
number_slider_2 = Slider(58, range=0..100)

# ---- group: RH_IN: p2
number_slider_3 = Slider(5, range=0..100)

# ----
file = ReadFile(File="C:\Users\huang\Downloads\ishigami_performance_maps.csv", PerLineParse=True)

# ---- group: RH_IN: z1
number_slider_4 = Slider(10, range=0..10)

# ---- group: RH_IN: z2
number_slider_5 = Slider(10, range=0..10)

# ----
csv = ReadCSV(CSVString=file, Delimiter=",")  # -> Headers, Values
division = Division(A=number_slider, B=Slider(100, range=0..100))
data = Data(Tree({0}: ["3.643042802810669", "4.931503772735596", "6.2099809646606445", "7.488457679748535", "8.766935348510742", "10.045412063598633"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], {1}: ["5.405666828155518", "5.398378372192383", "5.623215198516846", "5.848051071166992", "6.072887420654297", "6.29772424697876"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], {2}: ["12.962550163269043", "11.31159496307373", "9.792262077331543", "8.272928237915039", "6.753595352172852", "5.234261989593506"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], {3}: ["10.132946014404297", "10.364834785461426", "10.276434898376465", "10.188035011291504", "10.099635124206543", "10.011235237121582"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], {4}: ["9.350651741027832", "8.981249809265137", "8.793123245239258", "8.604995727539062", "8.416868209838867", "8.228740692138672"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], {5}: ["22.630434036254883", "22.93026351928711", "23.275197982788086", "23.620134353637695", "23.965070724487305", "24.31000518798828"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]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))
subtraction = Subtraction(A=1, B=division)
division_2 = Division(A=number_slider_4, B=Slider(10, range=0..100))
division_3 = Division(A=number_slider_5, B=Slider(10, range=0..10))
panel = Panel(csv.Headers)
flip = FlipMatrix(Data=data)
md_slider = MDSlider(
    SliderMode=0,
    slider_value=Point(0.2603281068, 0.2731769841, 0.5),
    x_domain=Domain(0, 1),
    y_domain=Domain(0, 1),
    z_domain=Domain(0, 1))
division_4 = Division(A=number_slider_3, B=Slider(100, range=0..100))
division_5 = Division(A=number_slider_2, B=Slider(100, range=0..100))

# ---- group: p1, p2
item = ListItem(List=flip, Index=40, Wrap=True)  # -> flatten(Item)
item_2 = ListItem(List=flip, Index=41, Wrap=True)  # -> flatten(Item)

# ----
pt = ConstructPoint(XCoordinate=division_5, YCoordinate=division_4, ZCoordinate=0)
pt_2 = Point(pt)
pdecon = Deconstruct(Point=pt_2)  # -> XComponent, YComponent, ZComponent
cluster = Cluster_3(num=item_2, B=pdecon.YComponent)
cluster_2 = Cluster_2(num=item, B=pdecon.XComponent)
bool = Boolean(cluster_2)
bool_2 = Boolean(cluster)
pdecon_2 = Deconstruct(Point=pt_2)  # -> XComponent, YComponent, ZComponent
and = GateAnd(A=bool, B=bool_2)
exclusion_radius = Slider(5, range=0..10)
dispatch = Dispatch(List=data, DispatchPattern=and)  # -> ListA, ListB

# ---- group: data list with target p-value
data_2 = Data(dispatch.ListA)

# ----
flip_2 = FlipMatrix(Data=data_2)

# ---- group: y2_predict
# Coordinates in the latent space
# mapped from 0 to 1
item_3 = ListItem(List=flip_2, Index=37, Wrap=True)  # -> flatten(Item)

# ---- group: y1_predict
item_4 = ListItem(List=flip_2, Index=36, Wrap=True)  # -> flatten(Item)

# ----
bounds = Bounds(Numbers=item_3)
bounds_2 = Bounds(Numbers=item_4)
pt_3 = ConstructPoint(XCoordinate=division_2, YCoordinate=division_3, ZCoordinate=0)

# ---- group: z1
item_5 = ListItem(List=flip_2, Index=38, Wrap=True)  # -> flatten(Item)

# ---- group: z2
item_6 = ListItem(List=flip_2, Index=39, Wrap=True)  # -> flatten(Item)

# ----
remap_numbers = RemapNumbers(Value=item_3, Source=bounds, Target=Domain(0, 0.5))  # -> Mapped, Clipped
remap_numbers_2 = RemapNumbers(Value=item_4, Source=bounds_2, Target=Domain(0, 0.5))  # -> Mapped, Clipped
multiplication = Multiplication(A=Slider(15, range=0..100), B=Slider(3, range=0..10))
pdecon_3 = Deconstruct(Point=pt_3)  # -> XComponent, YComponent, ZComponent

# ---- group: mapped y1
num = Number(remap_numbers_2.Mapped)

# ----
multiplication_2 = Multiplication(A=division, B=remap_numbers_2.Mapped)
multiplication_3 = Multiplication(A=subtraction, B=remap_numbers.Mapped)
plane_surface = PlaneSurface(Plane=PlaneXY(0, 0, 0), XSize=multiplication, YSize=multiplication)
addition = Addition(A=multiplication_2, B=multiplication_3)
bounds_3 = Bounds(Numbers=addition)
remap_numbers_3 = RemapNumbers(Value=addition, Source=bounds_3, Target=Domain(0, 0.5))  # -> Mapped, Clipped
Z = UnitZ(Factor=Slider(0.92, range=0..1))
mesh = Mesh(plane_surface)

# ---- group: weighted score
num_2 = Number(remap_numbers_3.Mapped)

# ----
triremesh = TriRemesh(Geometry=mesh, Iterations=25)  # -> Triangulation, Dual, Creases
extr = Extrude(Base=plane_surface, Direction=Z)
remap_numbers_4 = RemapNumbers(Value=pdecon_3.XComponent, Source=Domain(0, 1), Target=Domain(0, 1))  # -> Mapped, Clipped
debrep = DeconstructBrep(Brep=extr)  # -> Faces, Edges, Vertices
pt_4 = ConstructPoint(XCoordinate=item_5, YCoordinate=item_6, ZCoordinate=0)

# ----
# Visualize moving point
remap_numbers_5 = RemapNumbers(Value=pdecon_3.YComponent, Source=Domain(0, 1), Target=Domain(0, 1))  # -> Mapped, Clipped
sort_list = SortList(Keys=remap_numbers_3.Mapped)  # -> Keys, ValuesValuesA
construct_point = ConstructPoint(XCoordinate=remap_numbers_4.Mapped, YCoordinate=remap_numbers_5.Mapped, ZCoordinate=0)
list_item = ListItem(List=sort_list.Keys, Index=0, Wrap=True)  # -> Item1, Item
closest_point = ClosestPoint(Point=construct_point, Cloud=pt_4)  # -> ClosestPoint, CPIndex, Distance
number_slider_6 = Slider(10, range=0..10)
list_item_2 = ListItem(List=remap_numbers_3.Mapped, Index=closest_point.CPIndex, Wrap=True)
unit_z = UnitZ(Factor=list_item_2)
move = Move(Geometry=closest_point.ClosestPoint, Motion=unit_z)  # -> Geometry, Transform
gradient = Gradient(
    LowerLimit=list_item.Item,
    UpperLimit=list_item.Item1,
    Parameter=list_item_2,
    stops=[0.145: RGB(128, 255, 128), 0.85: RGB(192, 64, 0)])
mesh_sphere = MeshSphere(Base=move.Geometry, Radius=Slider(0.05, range=0..0.1), UCount=number_slider_6, VCount=number_slider_6)
mcol = MeshColours(Mesh=graft(mesh_sphere), Colours=graft(gradient))  # -> flatten(Mesh)

# ---- group: RH_OUT: edges
crv = Curve(debrep.Edges)

# ----
item_7 = ListItem(List=data_2, Index=closest_point.CPIndex, Wrap=True)  # -> flatten(Item)
construct_point_2 = ConstructPoint(XCoordinate=item_5, YCoordinate=item_6, ZCoordinate=0)
split = SplitList(List=item_7, Index=36)  # -> ListA, ListB

# ---- group: parameter data
data_3 = Data(split.ListA)

# ----
move_2 = Move(Geometry=mcol, Motion=Vector(0, 0, 10))  # -> Geometry, Transform
partition = PartitionList(List=data_3, Size=2)  # -> simplify(Chunks)
item_8 = ListItem(List=partition, Index=0, Wrap=True)  # -> Item, Item1
pt_5 = ConstructPoint(XCoordinate=item_8.Item, YCoordinate=item_8.Item1, ZCoordinate=0)  # -> flatten(Point)
neg = Negative(Value=Slider(37, range=0..100))
vec = VectorXYZ(XComponent=Slider(25, range=0..100), YComponent=neg, ZComponent=0)  # -> Vector, Length
neg_2 = Negative(Value=Slider(10, range=0..10))
vec_2 = VectorXYZ(XComponent=Slider(61, range=0..200), YComponent=neg_2, ZComponent=0)  # -> Vector, Length
point = Point(flatten(pt_5))

# ---- group: RH_OUT:y2_pred
item_9 = ListItem(List=item_3, Index=closest_point.CPIndex, Wrap=True)

# ---- group: RH_OUT:y1_pred
item_10 = ListItem(List=item_4, Index=closest_point.CPIndex, Wrap=True)

# ----
xy = XYPlane(Origin=Point(0, 0, 0))
move_3 = Move(Geometry=xy, Motion=vec_2.Vector)  # -> Geometry, Transform
join = TextJoin(Text=["performance 1: ", item_10])

# ---- group: RH_OUT:tag
tag = TextTag3D(Location=move_3.Geometry, Text=join, Size=5, Justification=7)

# ----
txt = Text()
unit_z_2 = UnitZ(Factor=Slider(12, range=6..20))  # -> expr("-x", UnitVector)
move_4 = Move(Geometry=point, Motion=unit_z_2)  # -> Geometry, Transform
line = Line(StartPoint=point, EndPoint=move_4.Geometry)
point_2 = Point(move_4.Geometry)
mesh_2 = Mesh(triremesh.Triangulation)
line_2 = Line(line)
supports = Point(point_2)
mesh_3 = Mesh(mesh_2)
pipe = Pipe(Curve=line_2, Radius=Slider(0.2, range=0..1), Caps=0)

# ---- group: RH_OUT:COLUMN
mesh_4 = Mesh(flatten(pipe))

# ---- group: RH_OUT:SLAB
preview = CustomPreview(Geometry=extr, Material=ColourSwatch(SwatchColor=RGBA(176, 109, 109, 101)))

# ----
material_selection_karamba3d = MaterialSelectionKaramba3D(menu=[dropdown(2), dropdown(1)])  # disabled
range = Range(Domain=Domain(1, 16), Steps=15)  # disabled
panel_2 = Panel("COLUMN")  # disabled
division_6 = Division(A=range, B=2)  # disabled
material_karamba3d = MaterialKaramba3D(material_selection_karamba3d)  # disabled
expression = Expression(x=panel_2, y=range, Expression="x&\" \"&y")  # disabled
cross_section_karamba3d = CrossSectionKaramba3D(
    FamilyNameOfCrossSection=panel_2,
    NameOfCrossSection=expression,
    Material=material_karamba3d,
    Diameter_in=range,
    WallThickness_in=division_6,
    mode="Circular Hollow")  # disabled

panel_3 = Panel("C")  # disabled
list_item_3 = ListItem(List=reverse(cross_section_karamba3d), Index=0, Wrap=True)  # disabled
crosecselect = CrossSectionSelectorKaramba3D(CrossSections=cross_section_karamba3d, ElementsIdentifiers=panel_3)  # -> CrossSection, Info; disabled

panel_4 = Panel("60")  # disabled
division_7 = Division(A=panel_4, B=1000)  # disabled
Z_2 = UnitZ(Factor=expr("-x", division_7))  # disabled
Z_3 = UnitZ(Factor=expr("-x", 1))  # disabled
loads_karamba3d = LoadsKaramba3D(Vector=Z_3, LCase="0", mode="Gravity")  # disabled
loads_karamba3d_2 = LoadsKaramba3D(Vector=Z_2, Mesh=mesh_3, LCase="0", mode="MeshLoad -Const.", menu=[buttons(on, off, off), buttons(on, on)])  # disabled
load_karamba3d = LoadKaramba3D(flatten([loads_karamba3d_2, loads_karamba3d]))  # disabled

panel_5 = Panel("ROOF")  # disabled
panel_6 = Panel("COLUMNS")  # disabled
line_to_beam_karamba3d = LineToBeamKaramba3D(
    Line=line_2,
    Identifier=panel_6,
    CrossSection=list_item_3,
    New=True,
    Remove=True,
    LimitDistance_ft=0.005,
    Bending=True,
    SetBucklingLength=True,
    ToPolylineMaxAngle=0.03,
    ToPolylineTolerance=0.01,
    ToPolylineMaxEdgeLength=0.25)  # -> Element, Points, Info; disabled
support_karamba3d = SupportKaramba3D(PosInd=supports, menu=[buttons(on, on, on, on, on, on)])  # disabled
panel_7 = Panel("ROOF")  # disabled
panel_8 = Panel("COLUMNS")  # disabled
number_slider_7 = Slider(60, range=0..100)  # disabled
Y = UnitY(Factor=number_slider_7)  # disabled
geo = Geometry(point)
license = LicenseKaramba3D()
lng = ListLength(List=geo)
ma = MassAddition(Input=flatten(lng))  # -> Result, PartialResults
total_column_amount = Panel(ma.Result)
# generate "room" and performance analysis
circle = CircleCNR(Center=geo, Normal=Vector(0, 0, 1), Radius=exclusion_radius)  # -> flatten(Circle)
rectangle = Rectangle(Plane=PlaneXY(0, 0, 0), XSize="45", YSize="45", Radius=0)  # -> Rectangle, Length
cluster_3 = Cluster(S=rectangle.Rectangle, C=circle)  # -> S_2, pt_3, pt_2
polygon = Polygon(Plane=geo, Radius=exclusion_radius, Segments=8, FilletRadius=0)  # -> Polygon, Length
geo_2 = Geometry(cluster_3.S_2)
explode = Explode(Curve=polygon.Polygon, Recursive=True)  # -> Segments, Vertices
area = Area(Geometry=geo_2)  # -> Area, Centroid
# remove space smaller than 9sqft
panel_9 = Panel("9")
smaller = SmallerThan(FirstNumber=panel_9, SecondNumber=area.Area)  # -> SmallerThan, OrEqualTo
area_2 = Area(Geometry=geo_2)  # -> Area, Centroid
cull = CullPattern(List=geo_2, CullPattern=smaller.SmallerThan)
cull_2 = CullPattern(List=area.Centroid, CullPattern=smaller.SmallerThan)
cull_3 = CullPattern(List=area.Area, CullPattern=smaller.SmallerThan)
division_8 = Division(A=cull_3, B="1")
explode_2 = Explode(Curve=rectangle.Rectangle, Recursive=True)  # -> Segments, Vertices

move_5 = Move(Geometry=cull, Motion="0,0,-12")  # -> Geometry, Transform

int = Integer(division_8)
analysis_grid = AnalysisGrid(ObstacleLines=flatten([explode.Segments, explode_2.Segments]), CellSize=1, FillPoint=area.Centroid)  # -> AnalysisPoints, GridCells; disabled

# ---- group: RH_OUT: CONSTRAINT
mesh_5 = Mesh(move_5.Geometry)

# ----
cull_4 = CullPattern(List=cluster_3.pt_3, CullPattern=graft(smaller.SmallerThan))
area_3 = Area(Geometry=move_5.Geometry)  # -> Area, Centroid
popgeo = PopulateGeometry(Geometry=cull, Count=int, Seed=1)
medges = MeshEdges(Mesh=mesh_5)  # -> NakedEdges, InteriorEdges, NonManifoldEdges
lng_2 = ListLength(List=cull_2)
points = PointList(Points=area_3.Centroid, Size=1)
bang = ExplodeTree(Data=cull_4)  # -> Branch0, Branch1, Branch2, Branch3, Branch4, Branch5, Branch6, Branch7

# ---- group: RH_OUT: Curves
crv_2 = Curve(medges.NakedEdges)

# ----
geo_3 = Geometry(bang.Branch3)
polygon_2 = Polygon(Plane=geo, Radius=0.5, Segments=8, FilletRadius=0)  # -> Polygon, Length
explode_3 = Explode(Curve=polygon_2.Polygon, Recursive=True)  # -> Segments, Vertices
list = ValueList({"Area": 0, "Area (Dist Weighted)": 1, "Perimeter": 2, "Compactness": 3, "Circularity": 4, "ConvexDeficiency": 5, "Occlusivity": 6, "Min Radial": 7, "Max Radial": 8, "Mean Radial": 9, "Standard Deviation": 10, "Variance": 11, "Skewness": 12, "Dispersion": 13, "Elongation": 14, "Drift Magnitude": 15, "Drift Angle": 16}, selected="Compactness")
list_2 = ValueList({"Area": 0, "Area (Dist Weighted)": 1, "Perimeter": 2, "Compactness": 3, "Circularity": 4, "ConvexDeficiency": 5, "Occlusivity": 6, "Min Radial": 7, "Max Radial": 8, "Mean Radial": 9, "Standard Deviation": 10, "Variance": 11, "Skewness": 12, "Dispersion": 13, "Elongation": 14, "Drift Magnitude": 15, "Drift Angle": 16}, selected="Occlusivity")
list_3 = ValueList({"Area": 0, "Area (Dist Weighted)": 1, "Perimeter": 2, "Compactness": 3, "Circularity": 4, "ConvexDeficiency": 5, "Occlusivity": 6, "Min Radial": 7, "Max Radial": 8, "Mean Radial": 9, "Standard Deviation": 10, "Variance": 11, "Skewness": 12, "Dispersion": 13, "Elongation": 14, "Drift Magnitude": 15, "Drift Angle": 16}, selected="Area")
list_4 = ValueList({"Area": 0, "Area (Dist Weighted)": 1, "Perimeter": 2, "Compactness": 3, "Circularity": 4, "ConvexDeficiency": 5, "Occlusivity": 6, "Min Radial": 7, "Max Radial": 8, "Mean Radial": 9, "Standard Deviation": 10, "Variance": 11, "Skewness": 12, "Dispersion": 13, "Elongation": 14, "Drift Magnitude": 15, "Drift Angle": 16}, selected="Mean Radial")
isovist = Isovist(
    VantagePointS=flatten(popgeo),
    ObstacleLines=flatten(explode_3.Segments),
    ViewingDirection=Vector(0, 1, 0),
    ViewingRange=360,
    ViewingAngle=360,
    Precision=360,
    ShowPolygon=True,
    ShowRadials=True,
    UseGPU=True)  # -> IsovistPolygon, Radials, ObstacleVisibility, IsovistProperties
item_11 = ListItem(List=isovist.IsovistPolygon, Index=100, Wrap=True)
item_12 = ListItem(List=isovist.IsovistProperties, Index=list, Wrap=True)  # -> flatten(Item)
item_13 = ListItem(List=isovist.IsovistProperties, Index=list_2, Wrap=True)  # -> flatten(Item)
item_14 = ListItem(List=isovist.IsovistProperties, Index=list_3, Wrap=True)  # -> flatten(Item)
item_15 = ListItem(List=isovist.IsovistProperties, Index=list_4, Wrap=True)  # -> flatten(Item)
data_4 = Data(flatten(cull_3))
room_area = Panel("3")

# ----
# isovist output - coloring analysis grid
# select isovist measure
list_5 = ValueList({"Area": 0, "Area (Dist Weighted)": 1, "Perimeter": 2, "Compactness": 3, "Circularity": 4, "ConvexDeficiency": 5, "Occlusivity": 6, "Min Radial": 7, "Max Radial": 8, "Mean Radial": 9, "Standard Deviation": 10, "Variance": 11, "Skewness": 12, "Dispersion": 13, "Elongation": 14, "Drift Magnitude": 15, "Drift Angle": 16}, selected="Compactness")
number_slider_8 = Slider(16, range=0..16)
value_list = ValueList({"relative color scale": 0, "absolute color scale": 1}, selected="relative color scale")
cheaper_rectangle = Geometry()
data_5 = Data(isovist.IsovistProperties)
item_16 = ListItem(List=data_5, Index=list_5, Wrap=True)  # -> flatten(Item)
bnd = Bounds(Numbers=item_16)
panel_10 = Panel(item_16)
dedomain = DeconstructDomain(Domain=bnd)  # -> Start, End
stream_filter = StreamFilter(Gate=value_list, Stream0=dedomain.Start, Stream1=0)
stream_filter_2 = StreamFilter(Gate=value_list, Stream0=dedomain.End)
gradient_2 = Gradient(
    LowerLimit=stream_filter,
    UpperLimit=stream_filter_2,
    Parameter=item_16,
    stops=[0: RGB(0, 0, 139), 0.254: RGB(50, 178, 206), 0.501: RGB(87, 166, 31), 0.748: RGB(255, 215, 0), 1: RGB(255, 0, 0)])
preview_2 = CustomPreview(Geometry=cheaper_rectangle, Shader=gradient_2)

match = MatchTree(Tree=graft(item_12), Guide=graft(popgeo))
match_2 = MatchTree(Tree=graft(item_13), Guide=graft(popgeo))
match_3 = MatchTree(Tree=graft(item_14), Guide=graft(popgeo))
match_4 = MatchTree(Tree=graft(item_15), Guide=graft(popgeo))
split_2 = SplitList(List=data_4, Index=room_area)  # -> ListA, ListB
trim = TrimTree(Tree=match, Depth=1)
trim_2 = TrimTree(Tree=match_2, Depth=1)
trim_3 = TrimTree(Tree=match_3, Depth=1)
trim_4 = TrimTree(Tree=match_4, Depth=1)
avr = Average(Input=data_4)
avr_2 = Average(Input=flatten(trim))
avr_3 = Average(Input=flatten(trim_2))
avr_4 = Average(Input=flatten(trim_3))
avr_5 = Average(Input=flatten(trim_4))
room_amount = Panel(lng_2)
room_area_of_largest_3 = Panel(avr)
average_compactness = Panel(avr_2)
average_circularity = Panel(avr_3)
average_visible_area = Panel(avr_4)
average_mean_radial = Panel(avr_5)

# ----
# Create Map
construct_point_3 = ConstructPoint(XCoordinate=item_5, YCoordinate=item_6, ZCoordinate=remap_numbers_3.Mapped)
partition_list = PartitionList(List=construct_point_3, Size=Slider(10, range=0..100))
settings_custom = SettingsCustom(
    StitchSeams=True,
    SimplePlanes=False,
    Refine=True,
    MinCount=16,
    MaxCount=400,
    AspectRatio=20,
    MaxDistance=0,
    MaxAngle=20,
    MinEdge=Slider(0.02, range=0..0.1),
    MaxEdge=0)
polyline = PolyLine(Vertices=partition_list, Closed=False)  # -> flatten(Polyline)
loft = Loft(Curves=polyline, Options={Adjust=False, Closed=False, LoftEnds=0, LoftSimp=0, LoftType=0, Rebuild=10, Refit=0.01})

# ---- group: Visualization of the map
mesh_brep = MeshBrep(Brep=loft, Settings=settings_custom)

# ----
quad_remesh = QuadRemesh(Mesh=mesh_brep, Settings={aqc=True, as=50, dhe=True, gci=0, null=False, pme=0, sa=0, tqc=2000})
deconstruct_mesh = DeconstructMesh(Mesh=quad_remesh)  # -> Vertices, Faces, Colours, Normals
deconstruct = Deconstruct(Point=deconstruct_mesh.Vertices)  # -> XComponent, YComponent, ZComponent
gradient_3 = Gradient(
    LowerLimit=0,
    UpperLimit=0.5,
    Parameter=deconstruct.ZComponent,
    stops=[0: RGB(234, 38, 0), 0.25: RGB(234, 126, 0), 0.5: RGB(254, 244, 84), 0.75: RGB(173, 203, 249), 1: RGB(75, 107, 169)])
mcol_2 = MeshColours(Mesh=quad_remesh, Colours=gradient_3)  # -> flatten(Mesh)

area_4 = Area(Geometry=mcol_2)  # -> Area, Centroid
merge = Merge(Data1=mcol_2, Data2=mcol)
scale = Scale(Geometry=merge, Center=area_4.Centroid, Factor=Slider(50, range=0..100))  # -> Geometry, Transform

# ---- group: RH_OUT:DESIGN_SPACE
move_6 = Move(Geometry=scale.Geometry, Motion=vec.Vector)  # -> Geometry, Transform

# ----
item_17 = ListItem(List=move_6.Geometry, Index=0, Wrap=True)
contour = Contour(Shape=item_17, Point=Point(0, 0, 0), Direction=Vector(0, 0, 1), Distance=Slider(1, range=0..1))

# ---- group: RH_OUT: Contours
crv_3 = Curve(contour)

# ---- group: define cross sections
material_selection_karamba3d_2 = MaterialSelectionKaramba3D(menu=[dropdown(1), dropdown(14)])  # disabled
number_slider_9 = Slider(7, range=2..15)  # disabled
panel_11 = Panel("0.5 to 4")  # disabled
panel_12 = Panel("Shell")  # disabled
range_2 = Range(Domain=panel_11, Steps=number_slider_9)  # disabled
expression_2 = Expression(x=panel_12, y=range_2, Expression="x&\" \"&y")  # disabled
panel_13 = Panel(range_2)  # disabled
panel_14 = Panel("S")  # disabled

# ----
material_karamba3d_2 = MaterialKaramba3D(material_selection_karamba3d_2)  # disabled

# ---- group: define cross sections (continued)
cross_section = CrossSectionKaramba3D(
    FamilyNameOfCrossSection=panel_12,
    NameOfCrossSection=graft(expression_2),
    Material=material_karamba3d_2,
    Height_cm=graft(range_2),
    mode="Shell - Const")  # -> flatten(CrossSection); disabled
crosecselect_2 = CrossSectionSelectorKaramba3D(CrossSections=cross_section, ElementsIdentifiers=panel_14)  # -> CrossSection, Info; disabled

# ----
panel_15 = Panel(crosecselect_2.CrossSection)  # disabled
list_item_4 = ListItem(List=reverse(cross_section), Index=0, Wrap=True)  # disabled
mesh_to_shell_karamba3d = MeshToShellKaramba3D(Mesh=mesh_3, Identifier=panel_5, CrossSection=list_item_4, LimitDistance_ft=0.005)  # -> Element, Points, Info; disabled
element_karamba3d = ElementKaramba3D(flatten([mesh_to_shell_karamba3d.Element, line_to_beam_karamba3d.Element]))  # disabled
assemble_model_karamba3d = AssembleModelKaramba3D(Elem=element_karamba3d, Support=support_karamba3d, Load=load_karamba3d, LimitDistance_ft=0.005)  # -> Model, Info, Mass_lbm, CenterOfGravity, LoadCaseNames; disabled
panel_16 = Panel(assemble_model_karamba3d.Mass_lbm)  # disabled
optimize_cross_section_karamba3d = OptimizeCrossSectionKaramba3D(
    Model=assemble_model_karamba3d.Model,
    ElemIdentifiers=panel_7,
    CrossSections=cross_section,
    MaximumUtilization=0.9,
    MaximumDisplacement_in=10,
    UltimateLimitStateIterations=5,
    DisplacementIterations=5,
    NumberOfSamplePoints=3,
    ElasticDesign=True,
    GammaM0=1,
    GammaM1=1.1,
    SwayFrame=True)  # -> ModelWithOptimizedCrossSections, Info, Mass_lbm, MaximumDisplacement_in, ElasticEnergyChange_kip_ft; disabled
optimize_cross_section_karamba3d_2 = OptimizeCrossSectionKaramba3D(
    Model=optimize_cross_section_karamba3d.ModelWithOptimizedCrossSections,
    ElemIdentifiers=panel_8,
    CrossSections=cross_section_karamba3d,
    MaximumUtilization=0.8,
    UltimateLimitStateIterations=5,
    DisplacementIterations=5,
    NumberOfSamplePoints=3,
    ElasticDesign=True,
    GammaM0=1,
    GammaM1=1.1,
    SwayFrame=True)  # -> ModelWithOptimizedCrossSections, Info, Mass_lbm, MaximumDisplacement_in, ElasticEnergyChange_kip_ft; disabled
panel_17 = Panel(optimize_cross_section_karamba3d.Mass_lbm)  # disabled
analyze_karamba3d = AnalyzeKaramba3D(Model=optimize_cross_section_karamba3d_2.ModelWithOptimizedCrossSections)  # -> CalculatedModel, MaximumDisplacement_in, ResultingForceOfGravity_kips, ElasticEnergy_kip_ft; disabled
panel_18 = Panel(optimize_cross_section_karamba3d_2.Mass_lbm)  # disabled
panel_19 = Panel(analyze_karamba3d.MaximumDisplacement_in)  # disabled
model_view_karamba3d = ModelViewKaramba3D(
    Model=[analyze_karamba3d.CalculatedModel, optimize_cross_section_karamba3d_2.ModelWithOptimizedCrossSections],
    ResultFactors=1,
    ResultCase=-1)  # -> Model, DeformedMesh, DeformedAxes, DeformedModel; disabled
shell_view_karamba3d = ShellViewKaramba3D(Model=model_view_karamba3d.Model, IndexOfLayer=0)  # -> Model, MeshesOfRenderedShells, LegendColors, LegendTags; disabled
beamview = BeamViewKaramba3D(Model=model_view_karamba3d.Model)  # -> Model, MeshesOfRenderedBeams, DeformedBeamAxes, LegendColors, LegendTags; disabled
item_18 = ListItem(List=flatten(beamview.MeshesOfRenderedBeams), Index=0, Wrap=True)  # disabled
mesh_6 = Mesh(shell_view_karamba3d.MeshesOfRenderedShells)  # disabled
legend = Legend(Colour=shell_view_karamba3d.LegendColors, Tags=shell_view_karamba3d.LegendTags, LegendType=1)  # disabled
deconstruct_mesh_2 = DeconstructMesh(Mesh=mesh_6)  # -> Vertices, Faces, Colours, Normals; disabled
panel_20 = Panel(shell_view_karamba3d.LegendTags)  # disabled
bnd_2 = Bounds(Numbers=deconstruct_mesh_2.Colours)  # disabled
dedomain_2 = DeconstructDomain(Domain=bnd_2)  # -> Start, End; disabled
gradient_4 = Gradient(
    LowerLimit=dedomain_2.Start,
    UpperLimit=dedomain_2.End,
    Parameter=deconstruct_mesh_2.Colours,
    stops=[0: RGB(255, 255, 255), 1: RGB(192, 192, 192)])  # disabled
conmesh = ConstructMesh(Vertices=deconstruct_mesh_2.Vertices, Faces=deconstruct_mesh_2.Faces, Colours=gradient_4)  # disabled
item_19 = ListItem(List=flatten(conmesh), Index=0, Wrap=True)  # disabled
merge_2 = Merge(Data1=item_18, Data2=item_19)  # disabled

# ---- group: RH_OUT:STRUCTURLA ANALYSIS
move_7 = Move(Geometry=flatten(merge_2), Motion=Y)  # -> Geometry, Transform; disabled

# ==== cluster Cluster
S = ClusterInput()
mesh_uv = MeshSurface(Surface=S, UCount="45", VCount="45", Overhang=True, Equalize=False)
faceb = FaceBoundaries(Mesh=mesh_uv)
curvepoint = PointOnCurve(faceb, parameter=0)
move = Move(Geometry=curvepoint, Motion="0.5,0.5,0")  # -> Geometry, Transform
C = ClusterInput()
incurves = PointInCurves(Point=move.Geometry, Curves=C)  # -> Relationship, Index, Point
bool = Boolean(invert(incurves.Relationship))
cull = CullPattern(List=faceb, CullPattern=bool)
quad = MeshQuad(CornerA=0, CornerB=1, CornerC=2, CornerD=3)
explode = Explode(Curve=cull, Recursive=True)  # -> Segments, Vertices; disabled
split = SplitList(List=explode.Vertices, Index=4)  # -> simplify(ListA), ListB; disabled
curvepoint_2 = PointOnCurve(cull, parameter=0)
runion = RegionUnion(Curves=cull)
panel = Panel("0")  # disabled
panel_2 = Panel("1")  # disabled
panel_3 = Panel("2")  # disabled
panel_4 = Panel("3")  # disabled
item = ListItem(List=split.ListA, Index=panel_4, Wrap=True)  # disabled
move_2 = Move(Geometry=curvepoint_2, Motion="0.5,0.5,0")  # -> Geometry, Transform
item_2 = ListItem(List=split.ListA, Index=panel, Wrap=True)  # disabled
item_3 = ListItem(List=split.ListA, Index=panel_2, Wrap=True)  # disabled
item_4 = ListItem(List=split.ListA, Index=panel_3, Wrap=True)  # disabled
conmesh = ConstructMesh(Vertices=split.ListA, Faces={A=0, B=1, C=2, D=3})  # -> flatten(Mesh); disabled
offset = OffsetCurve(Curve=runion, Distance=-0.1, Corners=1)  # -> flatten(Curve)
quad_2 = MeshQuad(CornerA=item_2, CornerB=item_3, CornerC=item_4, CornerD=item)  # -> flatten(Face); disabled
boundary = BoundarySurfaces(Edges=offset)
incurve = PointInCurve(Point=move_2.Geometry, Curve=graft(offset))  # -> Relationship, Point
munion = MeshUnion(Meshes=conmesh)  # disabled
cull_2 = CullPattern(List=move_2.Geometry, CullPattern=incurve.Relationship)
panel_5 = Panel("Invalid Mesh")  # disabled
S_2 = ClusterOutput(boundary)
pt = Point(cull_2)
panel_6 = Panel(munion)  # disabled
txt = Text(panel_6)  # disabled
pt_2 = ClusterOutput()
pt_3 = ClusterOutput(pt)
expression = Expression(x=txt, y=panel_5, Expression="if(x=y,0,1)")  # disabled
cull_3 = CullPattern(List=munion, CullPattern=expression)  # disabled

# ==== cluster Cluster_2
B = ClusterInput()
num = ClusterInput()
num_2 = Number(num)
pccountunique = CountUnique(Key=num_2, SortIfPossible=False, LastSaveLocalization="neutral,N")  # -> KeyList, Count
subtraction = Subtraction(A=pccountunique.KeyList, B=B)
abs = Absolute(Value=subtraction)
sort = SortList(Keys=abs, ValuesA=pccountunique.KeyList)  # -> Keys, ValuesA
item = ListItem(List=sort.ValuesA, Index=0, Wrap=True)
equals = Equality(FirstNumber=num_2, SecondNumber=item)  # -> Equality, Inequality
equality = ClusterOutput(equals.Equality)

# ==== cluster Cluster_3
num = ClusterInput()
B = ClusterInput()
num_2 = Number(num)
pccountunique = CountUnique(Key=num_2, SortIfPossible=False, LastSaveLocalization="neutral,N")  # -> KeyList, Count
subtraction = Subtraction(A=pccountunique.KeyList, B=B)
abs = Absolute(Value=subtraction)
sort = SortList(Keys=abs, ValuesA=pccountunique.KeyList)  # -> Keys, ValuesA
item = ListItem(List=sort.ValuesA, Index=0, Wrap=True)
equals = Equality(FirstNumber=num_2, SecondNumber=item)  # -> Equality, Inequality
equality = ClusterOutput(equals.Equality)
