# Grasshopper definition VAE_Voronoi.gh (Grasshopper 1.0.7)
# plug-ins: TT Toolbox, Karamba3D, Kangaroo2 Components, LunchBox

# ---- group: RH_IN: w1
number_slider = Slider(48, range=0..100)

# ---- group: RH_IN: w2
number_slider_2 = Slider(50, range=0..100)

# ----
file = ReadFile(File="C:\Users\huang\Downloads\voronoi_data_fake.csv", PerLineParse=True)

# ---- group: RH_IN: z1
number_slider_3 = Slider(87, range=0..100)

# ---- group: RH_IN: z2
number_slider_4 = Slider(80, range=0..100)

# ----
csv = ReadCSV(CSVString=file, Delimiter=",")  # -> Headers, Values
division = Division(A=number_slider_3, B=Slider(100, range=0..100))
division_2 = Division(A=number_slider_4, B=Slider(100, range=0..100))
panel = Panel(csv.Headers)
flip = FlipMatrix(Data=csv.Values)
division_3 = Division(A=number_slider_2, B=Slider(100, range=0..100))
division_4 = Division(A=number_slider, B=Slider(100, range=0..100))

# ---- group: p1, p2
item = ListItem(List=flip, Index=624, Wrap=True)  # -> flatten(Item)
item_2 = ListItem(List=flip, Index=625, Wrap=True)  # -> flatten(Item)

# ----
pt = ConstructPoint(XCoordinate=division_4, YCoordinate=division_3, ZCoordinate=0)
md_slider = MDSlider(
    SliderMode=0,
    slider_value=Point(0.8672058989, 0.6647472847, 0.5),
    x_domain=Domain(0, 1),
    y_domain=Domain(0, 1),
    z_domain=Domain(0, 1))
pt_2 = Point(pt)
pdecon = Deconstruct(Point=pt_2)  # -> XComponent, YComponent, ZComponent
cluster = Cluster(num=item_2, B=pdecon.YComponent)
cluster_2 = Cluster(num=item, B=pdecon.XComponent)
c_script = CSharpScript(P1=item, P2=item_2, W1=pdecon.XComponent, W2=pdecon.YComponent)  # -> Out, A
bool = Boolean(cluster_2)
number_slider_5 = Slider(60, range=15..70)
bool_2 = Boolean(cluster)
number_slider_6 = Slider(20, range=5..45)
pdecon_2 = Deconstruct(Point=pt_2)  # -> XComponent, YComponent, ZComponent
z_seed = Slider(50, range=31..50)
x_seed = Slider(30, range=1..30)
number_slider_7 = Slider(250, range=1..1000)
and = GateAnd(A=bool, B=bool_2)
dispatch = Dispatch(List=csv.Values, DispatchPattern=and)  # -> ListA, ListB
vec = VectorXYZ(XComponent=number_slider_6, YComponent=0, ZComponent=0)  # -> Vector, Length
vec_2 = VectorXYZ(XComponent=0, YComponent=0, ZComponent=number_slider_5)  # -> Vector, Length
vec_3 = VectorXYZ(XComponent=Slider(25, range=20..35), YComponent=0, ZComponent=Slider(25, range=1..50))  # -> Vector, Length
pt_3 = ConstructPoint(XCoordinate="0", YCoordinate="0", ZCoordinate="0")
move = Move(Geometry=pt_3, Motion=vec_2.Vector)  # -> Geometry, Transform
move_2 = Move(Geometry=pt_3, Motion=vec.Vector)  # -> Geometry, Transform
move_3 = Move(Geometry=pt_3, Motion=vec_3.Vector)  # -> Geometry, Transform

# ---- group: data list with target p-value
data = Data(dispatch.ListA)

# ----
flip_2 = FlipMatrix(Data=data)

# ---- group: y1_predict
item_3 = ListItem(List=flip_2, Index=620, Wrap=True)  # -> flatten(Item)

# ---- group: y2_predict
# Coordinates in the latent space
# mapped from 0 to 1
item_4 = ListItem(List=flip_2, Index=621, Wrap=True)  # -> flatten(Item)

# ----
bounds = Bounds(Numbers=item_4)
ln = Line(StartPoint=pt_3, EndPoint=move.Geometry)
arc = Arc3Pt(PointA=move.Geometry, PointB=move_3.Geometry, PointC=move_2.Geometry)  # -> Arc, Plane, Radius
ln_2 = Line(StartPoint=pt_3, EndPoint=move_2.Geometry)
bounds_2 = Bounds(Numbers=item_3)
pt_4 = ConstructPoint(XCoordinate=division, YCoordinate=division_2, ZCoordinate=0)

# ---- group: z1
item_5 = ListItem(List=flip_2, Index=622, Wrap=True)  # -> flatten(Item)

# ---- group: z2
item_6 = ListItem(List=flip_2, Index=623, Wrap=True)  # -> flatten(Item)

# ----
crv = Curve(ln_2)
crv_2 = Curve(ln)
crv_3 = Curve(arc.Arc)
remap_numbers = RemapNumbers(Value=item_3, Source=bounds_2, Target=Domain(0, 0.5))  # -> Mapped, Clipped
remap_numbers_2 = RemapNumbers(Value=item_4, Source=bounds, Target=Domain(0, 0.5))  # -> Mapped, Clipped
len = Length(Curve=crv_3)
merge = Merge(Data1=crv_2, Data2=crv, Data3=crv_3)
divide = DivideCurve(Curve=crv_3, Count=Slider(10, range=1..50), Kinks=False)  # -> Points, Tangents, Parameters
pdecon_3 = Deconstruct(Point=pt_4)  # -> XComponent, YComponent, ZComponent
multiplication = Multiplication(A=pdecon_2.XComponent, B=remap_numbers.Mapped)
multiplication_2 = Multiplication(A=pdecon_2.YComponent, B=remap_numbers_2.Mapped)
join = JoinCurves(Curves=merge, Preserve=False)
pdecon_4 = Deconstruct(Point=divide.Points)  # -> XComponent, YComponent, ZComponent
addition = Addition(A=multiplication, B=multiplication_2)
bounds_3 = Bounds(Numbers=addition)
expression = Expression(x=pdecon_4.ZComponent, Expression="if(x≥0,\"True\",\"False\")")
expression_2 = Expression(x=pdecon_4.ZComponent, Expression="if(x≥0,\"True\",\"False\")")
remap_numbers_3 = RemapNumbers(Value=addition, Source=bounds_3, Target=Domain(0, 0.5))  # -> Mapped, Clipped
remap_numbers_4 = RemapNumbers(Value=pdecon_3.XComponent, Source=Domain(0, 1), Target=Domain(0, 1))  # -> Mapped, Clipped
cull = CullPattern(List=pdecon_4.ZComponent, CullPattern=expression)
cull_2 = CullPattern(List=pdecon_4.XComponent, CullPattern=expression_2)
expression_3 = Expression(x=cull, y=number_slider_5, Expression="if(x≤y,\"True\",\"False\")")
expression_4 = Expression(x=cull_2, y=number_slider_6, Expression="if(x≤y,\"True\",\"False\")")
neg = Negative(Value=cull_2)
neg_2 = Negative(Value=cull)
sort = SortList(Keys=neg)  # -> Keys, ValuesA
sort_2 = SortList(Keys=neg_2)  # -> Keys, ValuesA
pt_5 = ConstructPoint(XCoordinate=item_5, YCoordinate=item_6, ZCoordinate=0)

# ----
# Visualize moving point
remap_numbers_5 = RemapNumbers(Value=pdecon_3.YComponent, Source=Domain(0, 1), Target=Domain(0, 1))  # -> Mapped, Clipped
sort_list = SortList(Keys=remap_numbers_3.Mapped)  # -> Keys, ValuesValuesA
construct_point = ConstructPoint(XCoordinate=remap_numbers_4.Mapped, YCoordinate=remap_numbers_5.Mapped, ZCoordinate=0)
list_item = ListItem(List=sort_list.Keys, Index=0, Wrap=True)  # -> Item1, Item
closest_point = ClosestPoint(Point=construct_point, Cloud=pt_5)  # -> ClosestPoint, CPIndex, Distance
number_slider_8 = Slider(10, range=0..10)
list_item_2 = ListItem(List=remap_numbers_3.Mapped, Index=closest_point.CPIndex, Wrap=True)
unit_z = UnitZ(Factor=list_item_2)
move_4 = Move(Geometry=closest_point.ClosestPoint, Motion=unit_z)  # -> Geometry, Transform
gradient = Gradient(
    LowerLimit=list_item.Item,
    UpperLimit=list_item.Item1,
    Parameter=list_item_2,
    stops=[0.145: RGB(128, 255, 128), 0.85: RGB(192, 64, 0)])
mesh_sphere = MeshSphere(Base=move_4.Geometry, Radius=Slider(0.05, range=0..0.1), UCount=number_slider_8, VCount=number_slider_8)
mcol = MeshColours(Mesh=graft(mesh_sphere), Colours=graft(gradient))  # -> flatten(Mesh)

abs = Absolute(Value=sort.Keys)
abs_2 = Absolute(Value=sort_2.Keys)
item_7 = ListItem(List=abs, Index=0, Wrap=True)
item_8 = ListItem(List=abs_2, Index=0, Wrap=True)
cull_3 = CullPattern(List=cull_2, CullPattern=expression_4)
cull_4 = CullPattern(List=cull, CullPattern=expression_3)
dom = ConstructDomain(DomainStart=0, DomainEnd=item_7)
dom_2 = ConstructDomain(DomainStart=0, DomainEnd=item_8)
pt_6 = ConstructPoint(XCoordinate=0, YCoordinate=0, ZCoordinate=cull_4)
pt_7 = ConstructPoint(XCoordinate=cull_3, YCoordinate=0, ZCoordinate=0)
random = Random(Range=dom, Number=number_slider_7, Seed=x_seed)
random_2 = Random(Range=dom_2, Number=number_slider_7, Seed=z_seed)
item_9 = ListItem(List=data, Index=closest_point.CPIndex, Wrap=True)  # -> flatten(Item)
construct_point_2 = ConstructPoint(XCoordinate=item_5, YCoordinate=item_6, ZCoordinate=0)
pt_8 = ConstructPoint(XCoordinate=item_7, YCoordinate=0, ZCoordinate=item_8)
# Design Inputs (Section Information)
pt_9 = ConstructPoint(XCoordinate=random, YCoordinate=0, ZCoordinate=random_2)
cullduppoints = RemoveDuplicatePoints(InputPoints=[pt_6, pt_7, pt_9, divide.Points], Tolerance=0.001)  # -> OutputPoints, FirstPointIndexes
duppt = RemoveDuplicatePts(Points=[divide.Points, pt_6, pt_7, pt_9], Tolerance=0.01)
xz = XZPlane(Origin=Point(0, 0, 0))
rec_2pt = Rectangle2Pt(Plane=xz, PointA=pt_3, PointB=pt_8, Radius=0)  # -> Rectangle, Length
voronoi = Voronoi(Points=duppt, Boundary=rec_2pt.Rectangle, Plane=xz, BruteForceOverride=False)
split = SplitList(List=item_9, Index=620)  # -> ListA, ListB
debrep = DeconstructBrep(Brep=voronoi)  # -> Faces, Edges, Vertices
flatten = FlattenTree(Tree=debrep.Edges, Path="{0}")

# ---- group: parameter data
data_2 = Data(split.ListA)

# ----
move_5 = Move(Geometry=mcol, Motion=Vector(0, 0, 10))  # -> Geometry, Transform
trim = TrimWithRegion(Curve=flatten, Region=join, Plane=xz)  # -> Inside, Outside
crv_4 = Curve(trim.Inside)
shift = ShiftList(List=flatten(crv_4), Shift=-1, Wrap=True)
curvepoint = PointOnCurve(crv_4, parameter=0)
item_10 = ListItem(List=shift, Index=0, Wrap=True)
flatten_2 = FlattenTree(Tree=curvepoint, Path="{0}")
crv_5 = Curve(item_10)
neg_3 = Negative(Value=Slider(37, range=0..100))
incurve = PointInCurve(Point=flatten(flatten_2), Curve=join)  # -> flatten(Relationship), Point
flatten_3 = FlattenTree(Tree=crv_4, Path="{0}")
vec_4 = VectorXYZ(XComponent=Slider(25, range=0..100), YComponent=neg_3, ZComponent=0)  # -> Vector, Length
num = Number(incurve.Relationship)
len_2 = Length(Curve=flatten_3)
expression_5 = Expression(x=num, Expression="if(x=1,\"True\",\"False\")")
expression_6 = Expression(x=len_2, Expression="if(x>10,\"False\",\"True\")")
cull_5 = CullPattern(List=incurve.Point, CullPattern=expression_5)
rdpoints = RemoveDuplicatePointsKaramba3D(Point=cull_5, LimitDistance=0.005)  # -> OutPoint, Info, Indexes
pdecon_5 = Deconstruct(Point=rdpoints.OutPoint)  # -> XComponent, YComponent, ZComponent
num_2 = Number(pdecon_5.ZComponent)
num_3 = Number(pdecon_5.XComponent)
expression_7 = Expression(
    x=num_3,
    z=num_2,
    zmax=number_slider_5,
    Expression="if(z>0.1,if(x>0.1,\"True\",if(z-zmax≥0,\"True\",\"False\")),\"False\")")
cull_6 = CullPattern(List=rdpoints.OutPoint, CullPattern=expression_7)
alongcrv = SortAlongCurve(Points=cull_6, Curve=crv_3)  # -> Points, Indices
shift_2 = ShiftList(List=alongcrv.Points, Shift=-1, Wrap=True)
flatten_4 = FlattenTree(Tree=alongcrv.Points, Path="{0}")
ln_3 = Line(StartPoint=flatten_4, EndPoint=shift_2)
cull_i = CullIndex(List=ln_3, Indices=0, Wrap=True)
crv_6 = Curve(cull_i)
data_3 = Data(data_2)
multiplication_3 = Multiplication(A=data_3, B="20")
num_4 = Number(graft(multiplication_3))
division_5 = Division(A=num_4, B=2)
flatten_tree = FlattenTree(Tree=division_5, Path="{0}")
division_6 = Division(A=flatten_tree, B="100")

# ---- group: RH_OUT:y1_pred
item_11 = ListItem(List=item_3, Index=closest_point.CPIndex, Wrap=True)

# ---- group: RH_OUT:y2_pred
item_12 = ListItem(List=item_3, Index=closest_point.CPIndex, Wrap=True)

# ----
cull_7 = CullPattern(List=flatten_3, CullPattern=expression_6)
rdpoints_2 = RemoveDuplicatePointsKaramba3D(Point=flatten([flatten_2, cull_5]), LimitDistance=0.005)  # -> OutPoint, Info, Indexes; disabled
rdlines = RemoveDuplicateLinesKaramba3D(Line=cull_7, LimitDistance=0.005)  # -> OutLine, Info, Indexes
merge_2 = Merge(Data1=rdlines.OutLine, Data2=crv_6)  # -> flatten(Result)
midpt = CurveMiddle(Curve=merge_2)

# ---- group: RH_OUT:design
mp = MultiPipe(
    Curves=merge_2,
    NodeSize=division_6,
    SizePoints=midpt,
    EndOffset=1,
    StrutSize=1,
    Segment=0,
    KinkAngle=0.6,
    CubeFit=0,
    Caps=0)

# ----
pipe = Pipe(Curve=merge_2, Radius=division_6, Caps=0)
custom_preview = CustomPreview(Geometry=pipe, Material=ColourSwatch(SwatchColor=RGB(102, 102, 102)))

# ----
# Create Map
construct_point_3 = ConstructPoint(XCoordinate=item_5, YCoordinate=item_6, ZCoordinate=remap_numbers_3.Mapped)
partition_list = PartitionList(List=construct_point_3, Size=Slider(11, range=0..100))
settings_custom = SettingsCustom(
    StitchSeams=True,
    SimplePlanes=False,
    Refine=True,
    MinCount=16,
    MaxCount=400,
    AspectRatio=20,
    MaxDistance=0,
    MaxAngle=20,
    MinEdge=Slider(0.02, range=0..0.1),
    MaxEdge=0)
polyline = PolyLine(Vertices=partition_list, Closed=False)  # -> flatten(Polyline)
loft = Loft(Curves=polyline, Options={Adjust=False, Closed=False, LoftEnds=0, LoftSimp=0, LoftType=0, Rebuild=10, Refit=0.01})

# ---- group: Visualization of the map
mesh_brep = MeshBrep(Brep=loft, Settings=settings_custom)

# ----
quad_remesh = QuadRemesh(Mesh=mesh_brep, Settings={aqc=True, as=50, dhe=True, gci=0, null=False, pme=0, sa=0, tqc=2000})
deconstruct_mesh = DeconstructMesh(Mesh=quad_remesh)  # -> Vertices, Faces, Colours, Normals
deconstruct = Deconstruct(Point=deconstruct_mesh.Vertices)  # -> XComponent, YComponent, ZComponent
gradient_2 = Gradient(
    LowerLimit=0,
    UpperLimit=0.5,
    Parameter=deconstruct.ZComponent,
    stops=[0: RGB(234, 38, 0), 0.25: RGB(234, 126, 0), 0.5: RGB(254, 244, 84), 0.75: RGB(173, 203, 249), 1: RGB(75, 107, 169)])
mcol_2 = MeshColours(Mesh=quad_remesh, Colours=gradient_2)  # -> flatten(Mesh)

area = Area(Geometry=mcol_2)  # -> Area, Centroid
merge_3 = Merge(Data1=mcol_2, Data2=mcol)
scale = Scale(Geometry=merge_3, Center=area.Centroid, Factor=Slider(50, range=0..100))  # -> Geometry, Transform

# ---- group: RH_OUT:DESIGN_SPACE
move_6 = Move(Geometry=scale.Geometry, Motion=vec_4.Vector)  # -> Geometry, Transform

# ==== cluster Cluster
num = ClusterInput()
B = ClusterInput()
num_2 = Number(num)
pccountunique = CountUnique(Key=num_2, SortIfPossible=False, LastSaveLocalization="neutral,N")  # -> KeyList, Count
subtraction = Subtraction(A=pccountunique.KeyList, B=B)
abs = Absolute(Value=subtraction)
sort = SortList(Keys=abs, ValuesA=pccountunique.KeyList)  # -> Keys, ValuesA
item = ListItem(List=sort.ValuesA, Index=0, Wrap=True)
equals = Equality(FirstNumber=num_2, SecondNumber=item)  # -> Equality, Inequality
equality = ClusterOutput(equals.Equality)
